% Simulink data dictionary airsys_data_dict.sldd

air_quality_type = Simulink.Bus()
  co2: uint16
  pm: uint16
  tvoc: uint16

room_quality = Simulink.Signal(StorageClass="ExportedGlobal", DataType="Bus: air_quality_type")

sensor_rhi_type = Simulink.Bus()
  temp: double
  humi: double
  valid: boolean

sensor_ntc_type = Simulink.Bus()
  temp: double
  valid: boolean

intake_air = Simulink.Signal(StorageClass="ExportedGlobal", DataType="Bus: sensor_rhi_type")
supply_air = Simulink.Signal(StorageClass="ExportedGlobal", DataType="Bus: sensor_rhi_type")
return_air = Simulink.Signal(StorageClass="ExportedGlobal", DataType="Bus: sensor_rhi_type")
exhaust_air = Simulink.Signal(StorageClass="ExportedGlobal", DataType="Bus: sensor_rhi_type")
bypass_on = Simulink.Signal(StorageClass="ExportedGlobal", DataType="boolean")
recycle_level = Simulink.Signal(StorageClass="ExportedGlobal", DataType="uint8")

fan_speed_enum = enum(DefaultValue="auto")
  auto = 0
  low = 1
  mid = 2
  high = 3

ac_mode_enum = enum(DefaultValue="stop")
  stop = 0
  cold = 1
  hot = 2

user_cmd_type = Simulink.Bus()
  temp: double
  fan_spd: Enum: fan_speed_enum

ac_mode_ctrl = Simulink.Signal(DataType="Enum: ac_mode_enum")